# Grasshopper definition 1.1RandomWalker.gh (Grasshopper 1.0.7)

timer = Timer(TimerInterval=20, Target=c_script)  # disabled
c_script = CSharpScript(reset=Button())  # -> out, pts; inputs reset: Boolean
# ---------- c_script: C# ----------
    if(reset)
    {
      w = new Walker();
      points = new List<Point3d>();
    }

    w.step();
    points.Add(w.show());

    pts = points;
# ---------- c_script: C# additional code ----------
  Walker w;

  List<Point3d> points;

  class Walker
  {
    static Random random = new Random();

    int X;
    int Y;

    public Walker()
    {
      this.X = 0;
      this.Y = 0;
    }

    public Point3d show()
    {
      Point3d point = new Point3d(this.X, this.Y, 0);

      return point;
    }

    public void step()
    {
      int choice = random.Next(0, 4);

      if(choice == 0)
      {
        this.X++;
      }
      else if(choice == 1)
      {
        this.X--;
      }
      else if(choice == 2)
      {
        this.Y++;
      }
      else
      {
        this.Y--;
      }

    }
  }
# ---------- end c_script ----------
panel = Panel(c_script.pts)
