# Grasshopper definition 1.2BallBounce.gh (Grasshopper 1.0.7)

# ---- group: XY rectangle from 2 points
point = Point(<point referenced from the Rhino model>)
point_2 = Point(<point referenced from the Rhino model>)
vector_2pt = Vector2Pt(PointA=point, PointB=point_2, Unitize=False)  # -> Vector, Length
deconstruct_vector = DeconstructVector(Vector=vector_2pt.Vector)  # -> XComponent, YComponent, ZComponent
construct_domain = ConstructDomain(DomainStart=0, DomainEnd=deconstruct_vector.XComponent)
construct_domain_2 = ConstructDomain(DomainStart=0, DomainEnd=deconstruct_vector.YComponent)
xy_plane = XYPlane(Origin=point)
rectangle = Rectangle(Plane=xy_plane, XSize=construct_domain, YSize=construct_domain_2, Radius=0)  # -> Rectangle, Length

# ----
point_3 = Point(<point referenced from the Rhino model>)
point_4 = Point(<point referenced from the Rhino model>)
vector_2pt_2 = Vector2Pt(PointA=point_3, PointB=point_4, Unitize=False)  # -> Vector, Length
deconstruct_vector_2 = DeconstructVector(Vector=vector_2pt_2.Vector)  # -> XComponent, YComponent, ZComponent
construct_domain_3 = ConstructDomain(DomainStart=0, DomainEnd=deconstruct_vector_2.XComponent)
construct_domain_4 = ConstructDomain(DomainStart=0, DomainEnd=deconstruct_vector_2.YComponent)
xy_plane_2 = XYPlane(Origin=point_3)
rectangle_2 = Rectangle(Plane=xy_plane_2, XSize=construct_domain_3, YSize=construct_domain_4, Radius=0)  # -> Rectangle, Length

# ---- group: generate balls
rectangle_3 = Rectangle(rectangle.Rectangle)
timer = Timer(TimerInterval=50, Target=c_script)  # disabled
c_script = CSharpScript(ballCount=Slider(50, range=0..100), boundary=rectangle_3, radius=Slider(2, range=0..10), reset=Button())  # -> out, A; inputs ballCount: Int32, boundary: Rectangle3d, velocity: Vector3d, radius: Double, reset: Boolean
# ---------- c_script: C# ----------
    if(reset)
    {
      balls = new Ball[ballCount];
      for(int i = 0;i < ballCount;i++)
      {
        balls[i] = new Ball(boundary, radius);
      }
    }

    Circle[] circles = new Circle[ballCount];

    for(int i = 0;i < ballCount;i++)
    {
      balls[i].bounce(boundary);
      balls[i].move();
      circles[i] = balls[i].drawCircle();
    }

    A = circles;
# ---------- c_script: C# additional code ----------
  Ball[] balls;

  class Ball
  {
    static Random random = new Random();

    Point3d location;
    Vector3d velocity;
    double radius;

    public Ball(Rectangle3d rect, double radius)
    {
      this.location = rect.Center;
      this.velocity = new Vector3d(random.NextDouble(), random.NextDouble(), 0);
      this.radius = radius;
    }

    public Ball(Rectangle3d rect, Vector3d velo, double radius)
    {
      this.location = rect.Center;
      this.velocity = velo;
      this.radius = radius;
    }

    public void move()
    {
      this.location += this.velocity;
    }

    public void bounce(Rectangle3d rect)
    {
      if(location.X + this.radius > rect.Plane.OriginX + rect.Width
        || location.X - this.radius < rect.Plane.OriginX)
      {
        this.velocity.X = -this.velocity.X;
      }
      if(location.Y + this.radius > rect.Plane.OriginY + rect.Height
        || location.Y - this.radius < rect.Plane.OriginY)
      {
        this.velocity.Y = -this.velocity.Y;
      }
    }

    public Circle drawCircle()
    {
      Circle circle = new Circle(this.location, this.radius);
      return circle;
    }
  }
# ---------- end c_script ----------

# ----
rectangle_4 = Rectangle(rectangle_2.Rectangle)
timer_2 = Timer(TimerInterval=50, Target=c_script_2)  # disabled
c_script_2 = CSharpScript(ballCount=Slider(50, range=0..100), boundary=rectangle_4, radius=Slider(2, range=0..10), reset=Button())  # -> out, A; inputs ballCount: Int32, boundary: Rectangle3d, radius: Double, reset: Boolean
# ---------- c_script_2: C# ----------
    if(reset)
    {
      balls = new Ball[ballCount];
      for(int i = 0;i < ballCount;i++)
      {
        balls[i] = new Ball(boundary, radius);
      }
    }

    Circle[] circles = new Circle[ballCount];

    for(int i = 0;i < ballCount;i++)
    {
      balls[i].move();
      balls[i].bounce(boundary);
      circles[i] = balls[i].drawCircle();
    }

    A = circles;
# ---------- c_script_2: C# additional code ----------
  Ball[] balls;

  class Ball
  {
    static Random random = new Random();

    Point3d location;
    Vector3d velocity;
    double radius;

    public Ball(Rectangle3d rect, double radius)
    {
      this.location = rect.Center;
      this.radius = radius;
      this.velocity = new Vector3d(random.NextDouble(), random.NextDouble(), 0);
    }

    public void move()
    {
      this.location += this.velocity;
    }

    public void bounce(Rectangle3d rect)
    {
      if(this.location.X + this.radius > rect.Plane.OriginX + rect.Width
        || this.location.X - this.radius < rect.Plane.OriginX)
      {
        this.velocity.X = -this.velocity.X;
      }

      if(this.location.Y + this.radius > rect.Plane.OriginY + rect.Height
        || this.location.Y - this.radius < rect.Plane.OriginY)
      {
        this.velocity.Y = -this.velocity.Y;
      }
    }

    public Circle drawCircle()
    {
      Circle circle = new Circle(this.location, this.radius);
      return circle;
    }


  }
# ---------- end c_script_2 ----------

# ---- group: shader
rectangle_5 = Rectangle(rectangle.Rectangle)
circle = Circle(c_script.A)
area = Area(Geometry=circle)  # -> Area, Centroid
area_2 = Area(Geometry=rectangle_5)  # -> Area, Centroid
distance = Distance(PointA=area.Centroid, PointB=area_2.Centroid)
bounds = Bounds(Numbers=distance)
deconstruct_domain = DeconstructDomain(Domain=bounds)  # -> Start, End
gradient = Gradient(
    LowerLimit=deconstruct_domain.Start,
    UpperLimit=deconstruct_domain.End,
    Parameter=distance,
    stops=[0: RGB(234, 38, 0), 0.25: RGB(234, 126, 0), 0.5: RGB(254, 244, 84), 0.75: RGB(173, 203, 249), 1: RGB(75, 107, 169)])
custom_preview = CustomPreview(Geometry=circle, Material=gradient)

# ----
panel = Panel(c_script_2.out)

# ---- group: shader
circle_2 = Circle(c_script_2.A)
rectangle_6 = Rectangle(rectangle_2.Rectangle)
area_3 = Area(Geometry=circle_2)  # -> Area, Centroid
area_4 = Area(Geometry=rectangle_6)  # -> Area, Centroid
distance_2 = Distance(PointA=area_3.Centroid, PointB=area_4.Centroid)
bounds_2 = Bounds(Numbers=distance_2)
deconstruct_domain_2 = DeconstructDomain(Domain=bounds_2)  # -> Start, End
gradient_2 = Gradient(
    LowerLimit=deconstruct_domain_2.Start,
    UpperLimit=deconstruct_domain_2.End,
    Parameter=distance_2,
    stops=[0: RGB(234, 38, 0), 0.25: RGB(234, 126, 0), 0.5: RGB(254, 244, 84), 0.75: RGB(173, 203, 249), 1: RGB(75, 107, 169)])
custom_preview_2 = CustomPreview(Geometry=circle_2, Material=gradient_2)
