# Grasshopper definition 1.3Mover.gh (Grasshopper 1.0.7)

# ---- group: XY rectangle from 2 points
point = Point(<point referenced from the Rhino model>)
point_2 = Point(<point referenced from the Rhino model>)
vector_2pt = Vector2Pt(PointA=point, PointB=point_2, Unitize=False)  # -> Vector, Length
deconstruct_vector = DeconstructVector(Vector=vector_2pt.Vector)  # -> XComponent, YComponent, ZComponent
construct_domain = ConstructDomain(DomainStart=0, DomainEnd=deconstruct_vector.XComponent)
construct_domain_2 = ConstructDomain(DomainStart=0, DomainEnd=deconstruct_vector.YComponent)
xy_plane = XYPlane(Origin=point)
rectangle = Rectangle(Plane=xy_plane, XSize=construct_domain, YSize=construct_domain_2, Radius=0)  # -> Rectangle, Length

# ----
area = Area(Geometry=rectangle.Rectangle)  # -> Area, Centroid
vector_xyz = VectorXYZ(XComponent=Slider(1, range=0..10), YComponent=Slider(5, range=0..10), ZComponent=0)  # -> Vector, Length
rectangle_2 = Rectangle(rectangle.Rectangle)
point_3 = Point(<point referenced from the Rhino model>)
timer = Timer(TimerInterval=200, Target=c_script)  # disabled
c_script = CSharpScript(attractPoint=point_3, boundary=rectangle_2, startLocation=area.Centroid, startVelocity=vector_xyz.Vector, reset=Button())  # -> out, A; inputs attractPoint: Point3d, boundary: Rectangle3d, startLocation: Point3d, startVelocity: Vector3d, reset: Boolean
# ---------- c_script: C# ----------
    if(reset)
    {
      m = new Mover(startLocation);
      circles = new List<Circle>();
    }

    m.Update(attractPoint);
    m.Edges(boundary);
    circles.Add(m.display());

    if(circles.Count > 10)
    {
      circles.RemoveAt(0);
    }

    A = circles;
# ---------- c_script: C# additional code ----------
  Mover m;

  List<Circle> circles;

  class Mover
  {
    Point3d location;
    Vector3d velocity;
    Vector3d acceleration;

    public Mover(Point3d loc)
    {
      this.location = loc;
      this.velocity = new Vector3d(0, 0, 0);
      this.acceleration = new Vector3d(0, 0, 0);
    }

    public void Update(Point3d point)
    {
      this.acceleration = point - this.location;
      this.acceleration.Unitize();
      this.velocity += this.acceleration * 2;
      this.location += this.velocity;
    }

    public void Edges(Rectangle3d rect)
    {
      if(this.location.X > rect.Plane.OriginX + rect.Width)
      {
        this.location.X = rect.Plane.OriginX;
      }
      if(this.location.X < rect.Plane.OriginX)
      {
        this.location.X = rect.Plane.OriginX + rect.Width;
      }

      if(this.location.Y > rect.Plane.OriginY + rect.Height)
      {
        this.location.Y = rect.Plane.OriginY;
      }
      if(this.location.Y < rect.Plane.OriginY)
      {
        this.location.Y = rect.Plane.OriginY + rect.Height;
      }
    }

    public Circle display()
    {
      Circle circle = new Circle(this.location, 0.5);
      return circle;
    }
  }
# ---------- end c_script ----------
panel = Panel(c_script.out)
