# Grasshopper definition 1.4Force.gh (Grasshopper 1.0.7)

# ---- group: XY rectangle from 2 points
point = Point(<point referenced from the Rhino model>)
point_2 = Point(<point referenced from the Rhino model>)
vector_2pt = Vector2Pt(PointA=point, PointB=point_2, Unitize=False)  # -> Vector, Length
deconstruct_vector = DeconstructVector(Vector=vector_2pt.Vector)  # -> XComponent, YComponent, ZComponent
construct_domain = ConstructDomain(DomainStart=0, DomainEnd=deconstruct_vector.XComponent)
construct_domain_2 = ConstructDomain(DomainStart=0, DomainEnd=deconstruct_vector.YComponent)
xy_plane = XYPlane(Origin=point)
rectangle = Rectangle(Plane=xy_plane, XSize=construct_domain, YSize=construct_domain_2, Radius=0)  # -> Rectangle, Length

# ----
area = Area(Geometry=rectangle.Rectangle)  # -> Area, Centroid
vector_xyz = VectorXYZ(XComponent=Slider(4, range=0..10), YComponent=Slider(0.6, range=0..1), ZComponent=0)  # -> Vector, Length
button = Button()
rectangle_2 = Rectangle(rectangle.Rectangle)
timer = Timer(TimerInterval=1, Target=c_script_2)  # disabled
timer_2 = Timer(TimerInterval=100, Target=c_script)  # disabled
c_script = CSharpScript(boundary=rectangle_2, startLocation=area.Centroid, force=vector_xyz.Vector, reset=button, run=Toggle(False))  # -> out, A; inputs boundary: Rectangle3d, startLocation: Point3d, force: Vector3d, reset: Boolean, run: Boolean
# ---------- c_script: C# ----------
    bool perform = true;
    if(reset)
    {
      perform = false;
    }

    if(!perform)
    {
      m = new Mover(startLocation, boundary);
    }

    if(run)
    {
      m.applyForce(force);

      m.Update();
      m.Edges();
    }
    A = m.display();
# ---------- c_script: C# additional code ----------
  //bool didReset = false;

  Mover m;

  class Mover
  {
    private Point3d location;
    private Vector3d velocity;
    private Vector3d acceleration;
    private Rectangle3d boundary;

    private double a0;
    private double b0;
    private double a1;
    private double b1;

    public Mover(Point3d loc, Rectangle3d boundary)
    {
      this.location = loc;
      this.velocity = new Vector3d(0, 0, 0);
      this.acceleration = new Vector3d(0, 0, 0);
      this.boundary = boundary;

      this.a0 = boundary.Plane.OriginX;
      this.b0 = boundary.Plane.OriginX + boundary.Width;
      this.a1 = boundary.Plane.OriginY;
      this.b1 = boundary.Plane.OriginY + boundary.Height;
    }

    public void applyForce(Vector3d force)
    {
      this.acceleration = force;
    }

    public void Update()
    {
      this.velocity += this.acceleration;
      this.location += this.velocity;
    }

    public void Edges()
    {

      if(this.location.X > b0)
      {
        this.location.X = this.location.X - this.velocity.X;
        this.velocity.X = - this.velocity.X;
      }
      if(this.location.X < a0)
      {
        this.location.X = this.location.X - this.velocity.X;
        this.velocity.X = - this.velocity.X;
      }

      if(this.location.Y > b1)
      {
        this.location.Y = this.location.Y - this.velocity.Y;
        this.velocity.Y = - this.velocity.Y;
      }
      if(this.location.Y <= a1)
      {
        this.location.Y = this.location.Y - this.velocity.Y;
        this.velocity.Y = - this.velocity.Y;
      }
    }

    public Circle display()
    {
      Circle circle = new Circle(this.location, 0.5);
      return circle;
    }
  }
# ---------- end c_script ----------
c_script_2 = CSharpScript(boundary=rectangle_2, startLocation=area.Centroid, force=vector_xyz.Vector, reset=button)  # -> out, A; inputs boundary: Rectangle3d, startLocation: Point3d, force: Vector3d, reset: Boolean
# ---------- c_script_2: C# ----------
    if(reset)
    {
      m = new Mover(startLocation, boundary);
    }

    m.applyForce(force);

    m.Update();
    m.Edges();

    A = m.display();
# ---------- c_script_2: C# additional code ----------
  Mover m;

  class Mover
  {
    private Point3d location;
    private Vector3d velocity;
    private Vector3d acceleration;
    private Rectangle3d boundary;

    private double a0;
    private double b0;
    private double a1;
    private double b1;

    public Mover(Point3d loc, Rectangle3d boundary)
    {
      this.location = loc;
      this.velocity = new Vector3d(0, 0, 0);
      this.acceleration = new Vector3d(0, 0, 0);
      this.boundary = boundary;

      this.a0 = boundary.Plane.OriginX;
      this.b0 = boundary.Plane.OriginX + boundary.Width;
      this.a1 = boundary.Plane.OriginY;
      this.b1 = boundary.Plane.OriginY + boundary.Height;
    }

    public void applyForce(Vector3d force)
    {
      this.acceleration = force;
    }

    public void Update()
    {
      this.velocity += this.acceleration;
      this.location += this.velocity;
      //this.acceleration = Vector3d.Zero;
    }

    public void Edges()
    {

      if(this.location.X > b0)
      {
        this.location.X = b0;
        this.velocity.X = -this.velocity.X;
      }
      if(this.location.X < a0)
      {
        this.location.X = a0;
        this.velocity.X = -this.velocity.X;
      }

      if(this.location.Y > b1)
      {
        this.location.Y = b1;
        this.velocity.Y = -this.velocity.Y;
      }
      if(this.location.Y <= a1)
      {
        this.location.Y = a1;
        this.velocity.Y = -this.velocity.Y;
      }
    }

    public Circle display()
    {
      Circle circle = new Circle(this.location, 0.5);
      return circle;
    }
  }
# ---------- end c_script_2 ----------
