# Grasshopper definition 2.2Pendulum Simulation.gh (Grasshopper 1.0.7)
# plug-ins: NOC

timer = Timer(TimerInterval=20, Target=pendulumsimulation)  # disabled
pendulumsimulation = PendulumSimulation(Radius=Slider(10, range=0..10), Reset=Toggle(False), Damping=Slider(0.9, range=0..1))  # -> Ball, Line
